# Dynamo graph Dynamo_revit.dyn (Dynamo 2.6.1.8786)

select_model_element = DSModelElementSelection()  # 1 picked in the model
select_model_element_2 = DSModelElementSelection()  # 1 picked in the model
select_model_element_3 = DSModelElementSelection()  # 1 picked in the model
list_create = List.Create(item0=select_model_element, item1=select_model_element_2, item2=select_model_element_3)
geometry = Element.Geometry(element=list_create)
flatten = List.Flatten(list=geometry)
integer_slider = IntegerSlider(30, range=0..100 step 1)
code_block = CodeBlock(x=integer_slider) { 0..1..#x; }
pointAtParameter = Curve.PointAtParameter(curve=flatten, param=code_block, lacing=CrossProduct)
transpose = List.Transpose(lists=pointAtParameter)
family_types = FamilyTypes("frame:frame")
byPoints = AdaptiveComponent.ByPoints(points=transpose, familyType=family_types)
byPoints_2 = NurbsCurve.ByPoints(points=transpose)
integer_slider_2 = IntegerSlider(8, range=0..100 step 1)
code_block_2 = CodeBlock(x=integer_slider_2) { 0.1..0.9..#x; }
pointAtParameter_2 = Curve.PointAtParameter(curve=byPoints_2, param=code_block_2, lacing=CrossProduct)
transpose_2 = List.Transpose(lists=pointAtParameter_2)
byPoints_3 = PolyCurve.ByPoints(points=transpose_2)
explode = Geometry.Explode(geometry=byPoints_3)
code_block_3 = CodeBlock { [0,0.5,1]; }
pointAtParameter_3 = Curve.PointAtParameter(curve=explode@L1, param=code_block_3, lacing=CrossProduct)
family_types_2 = FamilyTypes("frame_v1:frame_v1")
byPoints_4 = AdaptiveComponent.ByPoints(points=pointAtParameter_3, familyType=family_types_2)
